# Grasshopper definition MOD-v1.gh (Grasshopper 1.0.4)

panel = Panel("KNOBs")
panel_2 = Panel("LEDs")
panel_3 = Panel("SWITCHES")
panel_4 = Panel("JOYSTICKs")
panel_5 = Panel("SCREWS")
target_center = Point([<point referenced from the Rhino model> x10])
target_center_2 = Point([<point referenced from the Rhino model> x4])
hole_center = Point(<point referenced from the Rhino model>)
hole_center_2 = Point(<point referenced from the Rhino model>)
target_center_3 = Point([<point referenced from the Rhino model> x10])
target_center_4 = Point([<point referenced from the Rhino model> x2])
hole = Curve(<curve referenced from the Rhino model>)
hole_2 = Curve(<curve referenced from the Rhino model>)
hole_center_3 = Point(<point referenced from the Rhino model>)
hole_center_4 = Point(<point referenced from the Rhino model>)
target_center_5 = Point([<point referenced from the Rhino model> x8])
hole_3 = Curve(<curve referenced from the Rhino model>)
hole_4 = Curve(<curve referenced from the Rhino model>)
hole_center_5 = Point(<point referenced from the Rhino model>)
hole_5 = Curve(<curve referenced from the Rhino model>)
xy = XYPlane(Origin=hole_center)
xy_2 = XYPlane(Origin=target_center)
xy_3 = XYPlane(Origin=hole_center_2)
xy_4 = XYPlane(Origin=target_center_2)
xy_5 = XYPlane(Origin=hole_center_3)
xy_6 = XYPlane(Origin=hole_center_4)
xy_7 = XYPlane(Origin=target_center_4)
xy_8 = XYPlane(Origin=target_center_3)
xy_9 = XYPlane(Origin=hole_center_5)
xy_10 = XYPlane(Origin=target_center_5)
orient = Orient(Geometry=hole, Source=xy, Target=xy_2)  # -> Geometry, Transform
orient_2 = Orient(Geometry=hole_2, Source=xy_3, Target=xy_4)  # -> Geometry, Transform
orient_3 = Orient(Geometry=hole_4, Source=xy_6, Target=xy_8)  # -> Geometry, Transform
orient_4 = Orient(Geometry=hole_3, Source=xy_5, Target=xy_7)  # -> Geometry, Transform
orient_5 = Orient(Geometry=hole_5, Source=xy_9, Target=xy_10)  # -> Geometry, Transform
merge = Merge(
    Data1=orient.Geometry,
    Data2=orient_2.Geometry,
    Data3=orient_3.Geometry,
    Data4=orient_4.Geometry,
    Data5=orient_5.Geometry)
