# Grasshopper definition MOL-v1_button-cap.gh (Grasshopper 1.0.4)

pt = Point(<point referenced from the Rhino model>)
number_slider = Slider(32, range=0..50)
circle = CircleCNR(Center=pt, Normal=Vector(0, 0, 1), Radius=Slider(4, range=0..10))
circle_2 = CircleCNR(Center=pt, Normal=Vector(0, 0, 1), Radius=Slider(2.65, range=0..10))
circle_3 = CircleCNR(Center=pt, Normal=Vector(0, 0, 1), Radius=Slider(6, range=0..10))
divide = DivideCurve(Curve=circle_2, Count=number_slider, Kinks=False)  # -> Points, Tangents, Parameters
divide_2 = DivideCurve(Curve=circle, Count=number_slider, Kinks=False)  # -> Points, Tangents, Parameters
division = Division(A=180, B=number_slider)
xy = XYPlane(Origin=pt)
cull = CullPattern(List=divide.Points, CullPattern=[False, False, True, True])
cull_2 = CullPattern(List=divide.Points, CullPattern=[False, False, True, True])
rotate = Rotate(Geometry=divide_2.Points, Angle=division, Plane=xy)  # -> Geometry, Transform
item = ListItem(List=divide.Points, Index=[0, 2], Wrap=True)
division_2 = Division(A=number_slider, B=2)
item_2 = ListItem(List=divide_2.Points, Index=1, Wrap=True)
merge = Merge(Data1=item, Data2=item_2)
shift = ShiftList(List=merge, Shift=1, Wrap=True)
pline = PolyLine(Vertices=shift, Closed=False)
arrcurve = CurveArray(Geometry=pline, Count=10)  # -> Geometry, Transform
