# Grasshopper definition MOMv2.gh (Grasshopper 1.0.4)

panel = Panel("KNOBs")
panel_2 = Panel("LEDs")
panel_3 = Panel("SWITCHES")
panel_4 = Panel("JOYSTICKs")
panel_5 = Panel("SCREWS")
panel_6 = Panel("LIGHT")
panel_7 = Panel("DISTANCE")
target_center = Point([<point referenced from the Rhino model> x6])
target_center_2 = Point([<point referenced from the Rhino model> x2])
hole_center = Point(<point referenced from the Rhino model>)
hole_center_2 = Point(<point referenced from the Rhino model>)
target_center_3 = Point([<point referenced from the Rhino model> x6])
target_center_4 = Point([<point referenced from the Rhino model> x4])
hole = Curve(<curve referenced from the Rhino model>)
hole_2 = Curve(<curve referenced from the Rhino model>)
hole_3 = Curve(<curve referenced from the Rhino model>)
target_center_5 = Point([<point referenced from the Rhino model> x4])
hole_center_3 = Point(<point referenced from the Rhino model>)
hole_center_4 = Point(<point referenced from the Rhino model>)
hole_center_5 = Point(<point referenced from the Rhino model>)
hole_4 = Curve(<curve referenced from the Rhino model>)
target_center_6 = Point([<point referenced from the Rhino model> x4])
hole_center_6 = Point(<point referenced from the Rhino model>)
hole_5 = Curve(<curve referenced from the Rhino model>)
hole_6 = Curve(<curve referenced from the Rhino model>)
hole_7 = Curve(<curve referenced from the Rhino model>)
target_center_7 = Point([<point referenced from the Rhino model> x56])
hole_center_7 = Point(<point referenced from the Rhino model>)
xy = XYPlane(Origin=hole_center)
xy_2 = XYPlane(Origin=hole_center_4)
xy_3 = XYPlane(Origin=target_center)
xy_4 = XYPlane(Origin=hole_center_2)
xy_5 = XYPlane(Origin=target_center_5)
xy_6 = XYPlane(Origin=target_center_2)
xy_7 = XYPlane(Origin=hole_center_6)
xy_8 = XYPlane(Origin=target_center_6)
xy_9 = XYPlane(Origin=hole_center_3)
xy_10 = XYPlane(Origin=hole_center_5)
xy_11 = XYPlane(Origin=target_center_4)
xy_12 = XYPlane(Origin=target_center_3)
xy_13 = XYPlane(Origin=hole_center_7)
xy_14 = XYPlane(Origin=target_center_7)
orient = Orient(Geometry=hole, Source=xy, Target=xy_3)  # -> Geometry, Transform
orient_2 = Orient(Geometry=hole_2, Source=xy_4, Target=xy_6)  # -> Geometry, Transform
orient_3 = Orient(Geometry=hole_3, Source=xy_2, Target=xy_5)  # -> Geometry, Transform
orient_4 = Orient(Geometry=hole_6, Source=xy_10, Target=xy_12)  # -> Geometry, Transform
orient_5 = Orient(Geometry=hole_4, Source=xy_7, Target=xy_8)  # -> Geometry, Transform
orient_6 = Orient(Geometry=hole_5, Source=xy_9, Target=xy_11)  # -> Geometry, Transform
orient_7 = Orient(Geometry=hole_7, Source=xy_13, Target=xy_14)  # -> Geometry, Transform
merge = Merge(
    Data1=orient.Geometry,
    Data2=orient_2.Geometry,
    Data3=orient_4.Geometry,
    Data4=orient_6.Geometry,
    Data5=orient_7.Geometry,
    Data6=orient_5.Geometry,
    Data7=orient_3.Geometry)
